# Grasshopper definition baeume_staffelung.gh (Grasshopper 1.0.8)

py3 = Python3Script(reset=Button())  # -> a
# ---------- py3: Python ----------
from compas_ghpython import unload_modules

unload_modules("jh_ghp_tools")

if reset:
    unload_modules("jh_ghp_tools")
# ---------- end py3 ----------

# ----
# Nicht mehr als 30 Bäume auf einmal
crv = Curve([<curve referenced from the Rhino model> x2])
py3_2 = Python3Script(C=crv)  # -> a; inputs C: list of Curve
# ---------- py3_2: Python ----------
from jh_ghp_tools import baeume_staffelung
import Rhino.Geometry as rg





a = baeume_staffelung(C)
# ---------- end py3_2 ----------
hatch = ModelHatch(Boundary=py3_2)  # -> Hatch, Boundary, Plane, HatchPattern, BasePoint, Rotation, Scale, ShowBoundary, Background, FillStyle
