# Grasshopper definition bake_objects_to_layers.gh (Grasshopper 1.0.8)

py3 = Python3Script(reset=Button())  # -> a
# ---------- py3: Python ----------
from compas_ghpython import unload_modules

unload_modules("jh_ghp_tools")

if reset:
    unload_modules("jh_ghp_tools")
# ---------- end py3 ----------
py3_2 = Python3Script(bake=Toggle(False))  # -> out, a; inputs obj: list of GeometryBase, lay: list
# ---------- py3_2: Python ----------
from jh_ghp_tools import bake_objects_to_layers


bake_objects_to_layers(obj, lay, bake)
# ---------- end py3_2 ----------
