# Grasshopper definition box_mapping.gh (Grasshopper 1.0.8)
# plug-ins: Human

pipeline = GeometryPipeline(
    GroupByLayer=False,
    GroupByType=False,
    IncludeHidden=True,
    IncludeLocked=True,
    LayerFilter="*",
    NameFilter="*",
    SublayerFiltering=True,
    TypeFilter=32)
id = Guid([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])
py3 = Python3Script(reset=Button())  # -> a
# ---------- py3: Python ----------
from compas_ghpython import unload_modules

unload_modules("jh_ghp_tools")

if reset:
    unload_modules("jh_ghp_tools")
# ---------- end py3 ----------
py3_2 = Python3Script(B=pipeline, ID=pipeline, X_dim=".5", Y_dim=".7", Z_dim=".5", update=Button())  # -> out, a; inputs B: list of GeometryBase, ID: list of Guid, X_dim: Double, Y_dim: Double, Z_dim: Double
# ---------- py3_2: Python ----------
from jh_ghp_tools import apply_box_mapping

a = apply_box_mapping(B, ID, X_dim, Y_dim, Z_dim, update)
# ---------- end py3_2 ----------
panel = Panel(py3_2.a)
debrep = DeconstructBrep()  # -> Faces, Edges, Vertices
mesh = Mesh(flatten(debrep.Faces))
boxmap = BoxMapping(Mesh=mesh)
bake = BakeGeometry(Bake=Button(), Geometry=boxmap, DeleteOldBakes=False, PreserveTrees=False)
