# Grasshopper definition flächenkanten löschen.gh (Grasshopper 1.0.8)

hatch = Hatch([<hatch referenced from the Rhino model> x537])
crv = Curve([<curve referenced from the Rhino model> x2320])
wires = BrepWireframe(Brep=hatch, Density=-1)
join = JoinCurves(Curves=wires, Preserve=False)  # -> flatten(Curves)
py3 = Python3Script(H=join, C=crv)  # -> out, a; inputs H: list of Curve, C: list of Curve; unedited script template
