# Grasshopper definition gekritzel aus punkten.gh (Grasshopper 1.0.8)

mesh = Mesh([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])
mesh_2 = Mesh([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])
mesh_3 = Mesh([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])
demesh = DeconstructMesh(Mesh=mesh_2)  # -> flatten(Vertices), Faces, Colours, Normals
py3 = Python3Script(reset=Button())  # -> a
# ---------- py3: Python ----------
from compas_ghpython import unload_modules

unload_modules("jh_ghp_tools")

if reset:
    unload_modules("jh_ghp_tools")
# ---------- end py3 ----------
cullpt = CullDuplicates(Points=demesh.Vertices, Tolerance=".02", CullMode=3)  # -> Points, Indices, Valence
py3_2 = Python3Script(P=cullpt.Points)  # -> C; inputs P: list of Point3d
# ---------- py3_2: Python ----------
from jh_ghp_tools import gekritzel_aus_punkten

C = gekritzel_aus_punkten(P)
# ---------- end py3_2 ----------
