# Grasshopper definition hatch_kanten_löschen.gh (Grasshopper 1.0.8)

crv = Curve([<curve referenced from the Rhino model> x272])
hatch = Hatch([<hatch referenced from the Rhino model> x21])
wires = BrepWireframe(Brep=hatch, Density=-1)
explode = Explode(Curve=crv, Recursive=True)  # -> simplify(Segments), Vertices
explode_2 = Explode(Curve=wires, Recursive=True)  # -> Segments, Vertices
py3 = Python3Script(A=explode.Segments, B=flatten(explode_2.Segments))  # -> out, a, b; inputs A: tree of Curve, B: list of Curve
# ---------- py3: Python ----------
import Rhino.Geometry as rg
import Grasshopper as gh

tol = 0.01
a_tree = gh.DataTree[rg.Curve]()
b_tree = gh.DataTree[rg.Curve]()

def endpoints_match(ca, cb, tol):
    ends_a = [ca.PointAtStart, ca.PointAtEnd]
    ends_b = [cb.PointAtStart, cb.PointAtEnd]
    return all(any(p.DistanceTo(q) <= tol for q in ends_b) for p in ends_a)

for i in range(A.BranchCount):
    path = A.Path(i)
    curves = A.Branch(i)
    
    a_branch = []
    b_branch = []
    
    for ca in curves:
        if any(endpoints_match(ca, cb, tol) for cb in B):
            a_branch.append(ca)
        else:
            b_branch.append(ca)
    
    a_tree.AddRange(a_branch, path)
    b_tree.AddRange(b_branch, path)

a = a_tree
b = b_tree
# ---------- end py3 ----------
join = JoinCurves(Curves=py3.b, Preserve=False)  # -> flatten(Curves)
crv_2 = Curve(join)
preview = CustomPreview(Geometry=py3.a, Material=ColourSwatch(SwatchColor=RGB(255, 0, 255)))
