# Grasshopper definition instant_huesli.gh (Grasshopper 1.0.8)

winkel = Slider(29, range=0..45)
giebel = Slider(0.5, range=0..1)
giebelhöhe = Panel("5")
rec = Rectangle({Plane=Plane(origin=(-0.1396216545, -4.643803249, 0), x=(0.6031501327, 0.7976276809, 0), y=(0.7976276809, -0.6031501327, 0)), Size=Domain2(u=-2.693068535..2.693068535, v=-1.825260655..1.825260655)})
crv = Curve([<curve referenced from the Rhino model> x2])
flip = BooleanToggle(False)
bake = Button()

py3 = Python3Script(reset=Button())  # -> a
# ---------- py3: Python ----------
from compas_ghpython import unload_modules

unload_modules("jh_ghp_tools")

if reset:
    unload_modules("jh_ghp_tools")
# ---------- end py3 ----------

py3_2 = Python3Script(C=crv, ghoe=giebelhöhe, gpos=giebel, fl=flip, W=winkel, bk=bake)  # -> out, a; inputs C: Curve, ghoe: Double, gpos: Double, fl: Boolean, W: Double, bk: Boolean
# ---------- py3_2: Python ----------
from jh_ghp_tools import instant_huesli
import ghpythonlib.components as gh


a = instant_huesli(C, ghoe, fl, gpos, W, bk)
# ---------- end py3_2 ----------
