# Grasshopper definition rampe im schnitt.gh (Grasshopper 1.0.8)

list = ValueList({"15", "18"}, selected="15")
py3 = Python3Script(Gh=Slider(3.997, range=2..5), Gef=list)  # -> C, L; inputs Gh: Double, Gef: Double
# ---------- py3: Python ----------
from jh_ghp_tools import rampe_im_schnitt


C, L = rampe_im_schnitt(Gh, Gef)
# ---------- end py3 ----------
panel = Panel(py3.L)
