# Grasshopper definition verlaufsschraffur.gh (Grasshopper 1.0.8)

# ---- group: Boundary Kurve
crv = Curve(<curve referenced from the Rhino model>)

# ----
py3 = Python3Script(reset=Button())  # -> a
# ---------- py3: Python ----------
from compas_ghpython import unload_modules

unload_modules("jh_ghp_tools")

if reset:
    unload_modules("jh_ghp_tools")
# ---------- end py3 ----------

# ---- group: Attractor 100%
crv_2 = Curve(<curve referenced from the Rhino model>)

# ---- group: Attractor0%
crv_3 = Curve(<curve referenced from the Rhino model>)

# ----
dichte = ValueList({"1:200": 10, "1:100": 10, "1:50": 10, "1:20": 10, "Isometrie Rothenburg": 0.8}, selected="1:200")
grösse_quadrant = ValueList({"1:200": 0.2, "1:100": 0.1, "1:50": 0.05, "1:20": 0.02, "Test": 1.0}, selected="1:200")
bbox = BoundingBox(Content=crv, Plane=PlaneXY(0, 0, 0))  # -> Box, Box_2
ug_rothrist = Panel("5")
area = Area(Geometry=bbox.Box)  # -> Area, Centroid
debox = DeconstructBox(Box=bbox.Box)  # -> Plane, X, Y, Z
expression = Expression(A=area.Area, q=grösse_quadrant, d=ug_rothrist, Expression="A/(q^2)*d")
dam = DataDam(DataA=debox.X, DataB=debox.Y, DataC=expression, DataD=crv, DataE=crv_2, DataF=crv_3, BufferDelay=10000000, BufferMode=0)  # -> DataA, DataB, DataC, DataD, DataE, DataF
ug_rothrist_2 = Panel(".06")
py3_2 = Python3Script(x_domain=dam.DataA, y_domain=dam.DataB, N=dam.DataC, CB=dam.DataD, C1=dam.DataE, C0=dam.DataF, cell_size=".5")  # -> points; inputs x_domain: Interval, y_domain: Interval, N: Int32, CB: Curve, C1: Curve, C0: Curve, cell_size: Double
# ---------- py3_2: Python ----------
from jh_ghp_tools import verlaufsschraffur

points = verlaufsschraffur(x_domain, y_domain, N, CB, C1, C0, cell_size)
# ---------- end py3_2 ----------
list = ValueList({"1:200": 0.04, "1:100": 0.02, "1:50": 0.01, "1:20": 0.004}, selected="1:200")
list_2 = ValueList({"1:200": 0.01, "1:100": 0.005, "1:50": 0.0025, "1:20": 0.001, "Isometrie Rothenburg": 0.1}, selected="1:200")
dam_2 = DataDam(DataA=py3_2, BufferDelay=10000000, BufferMode=0)
cullpt = CullDuplicates(Points=dam_2, Tolerance=ug_rothrist_2, CullMode=3)  # -> Points, Indices, Valence
py3_3 = Python3Script(P=cullpt.Points, L=list_2)  # -> C; inputs P: list of Point3d, L: Double
# ---------- py3_3: Python ----------
from jh_ghp_tools import random_lines_from_points


C = random_lines_from_points(P, L)
# ---------- end py3_3 ----------
group = Group(Objects=py3_3)
