# Grasshopper definition verlaufsschraffur_kurve_kurve.gh (Grasshopper 1.0.8)
# Copyright: 2022

# ---- group: Boundary Kurve
crv = Curve(<curve referenced from the Rhino model>)

# ----
py3 = Python3Script(reset=Button())  # -> a
# ---------- py3: Python ----------
from compas_ghpython import unload_modules

unload_modules("jh_ghp_tools")

if reset:
    unload_modules("jh_ghp_tools")
# ---------- end py3 ----------

# ---- group: Attractor 100%
crv_2 = Curve(<curve referenced from the Rhino model>)

# ---- group: Attractor0%
crv_3 = Curve(<curve referenced from the Rhino model>)

# ----
grösse_quadrant = ValueList({"1:500": 0.5, "1:200": 0.2, "1:100": 0.1, "1:50": 0.05, "1:20": 0.02, "Test": 1.0}, selected="1:50")

# ---- group: bleibt geng gleich weil Quadrant ändert
dichte = ValueList({"1:500": 10, "1:200": 10, "1:100": 10, "1:50": 10, "1:20": 10}, selected="1:50")

# ----
py3_2 = Python3Script(C=crv, sub_length=".5")  # -> polyline; inputs C: Curve, sub_length: Double
# ---------- py3_2: Python ----------
"""
Alles-in-einem-Version fuer ein einzelnes GhPython-Component.
Inputs am Component: curve (Curve), subdivision_length (float)
Output: polyline (Polyline)
"""

import Rhino


def find_corner_parameters(c):
    """Findet alle Parameter, an denen die Kurve C1-unstetig ist (harte Ecken)."""
    t0 = c.Domain.Min
    t1 = c.Domain.Max
    params = [t0]
    t = t0
    while True:
        found, t_disc = c.GetNextDiscontinuity(Rhino.Geometry.Continuity.C1_continuous, t, t1)
        if not found:
            break
        params.append(t_disc)
        t = t_disc
    params.append(t1)

    cleaned = [params[0]]
    for p in params[1:]:
        if p - cleaned[-1] > 1e-9:
            cleaned.append(p)
    return cleaned


def split_curve_at_corners(c):
    """Teilt eine Kurve an allen harten Ecken (C1-Unstetigkeiten) in Segmente."""
    params = find_corner_parameters(c)
    if len(params) <= 2:
        return [c]

    segments = c.Split(params[1:-1])
    return list(segments) if segments else [c]


def get_model_tolerance():
    """Liest die aktive Rhino-Dokumenttoleranz, mit Fallback fuer Standalone-Betrieb."""
    doc = Rhino.RhinoDoc.ActiveDoc
    return doc.ModelAbsoluteTolerance if doc else 0.001


def subdivide_segment(segment, sub_length, tol):
    """Gibt eine Punktliste fuer ein einzelnes Segment zurueck (Start und Ende inklusive)."""
    if segment.IsLinear(tol):
        return [segment.PointAtStart, segment.PointAtEnd]

    t_params = segment.DivideByLength(sub_length, True)
    if not t_params:
        return [segment.PointAtStart, segment.PointAtEnd]

    points = [segment.PointAt(t) for t in t_params]

    if points[-1].DistanceTo(segment.PointAtEnd) > 1e-6:
        points.append(segment.PointAtEnd)

    return points


def rebuild_curve_as_polyline(curve, sub_length):
    """Hauptfunktion."""
    tol = get_model_tolerance()
    segments = split_curve_at_corners(C)

    all_points = []
    for segment in segments:
        pts = subdivide_segment(segment, sub_length, tol)
        if all_points and all_points[-1].DistanceTo(pts[0]) < 1e-9:
            pts = pts[1:]
        all_points.extend(pts)

    return Rhino.Geometry.Polyline(all_points)


polyline = rebuild_curve_as_polyline(C, sub_length)
# ---------- end py3_2 ----------
bbox = BoundingBox(Content=crv, Plane=PlaneXY(0, 0, 0))  # -> Box, Box_2
isonometrie = Panel("0.8")
py3_3 = Python3Script(C=crv_2, sub_length=".5")  # -> polyline; inputs C: Curve, sub_length: Double; same code as py3_2
py3_4 = Python3Script(C=crv_3, sub_length=".5")  # -> polyline; inputs C: Curve, sub_length: Double; same code as py3_2
area = Area(Geometry=bbox.Box)  # -> Area, Centroid
debox = DeconstructBox(Box=bbox.Box)  # -> Plane, X, Y, Z
expression = Expression(A=area.Area, q=grösse_quadrant, d=dichte, Expression="A/(q^2)*d")
nicht_lineare_abnahme = ValueList({"nicht": 1, "1.2", "1.4", "1.6", "1.8", "stark": 2}, selected="1.8")
dam = DataDam(
    DataA=debox.X,
    DataB=debox.Y,
    DataC=expression,
    DataD=py3_2,
    DataE=py3_3,
    DataF=py3_4,
    BufferDelay=10000000,
    BufferMode=0)  # -> DataA, DataB, DataC, DataD, DataE, DataF
dam_2 = DataDam(DataA=debox.X, DataB=debox.Y, DataC=expression, DataD=py3_2, BufferDelay=10000000, BufferMode=0)  # -> DataA, DataB, DataC, DataD
list = ValueList({"1:500": 0.1, "1:200": 0.04, "1:100": 0.02, "1:50": 0.01, "1:20": 0.004}, selected="1:50")
py3_5 = Python3Script(x_domain=dam_2.DataA, y_domain=dam_2.DataB, N=dam_2.DataC, CB=dam_2.DataD, cell_size=".2", min_dist=list)  # -> points; inputs N: Int32, CB: Curve, cell_size: Double, min_dist: Double
# ---------- py3_5: Python ----------
from jh_ghp_tools import punktschraffur

points = punktschraffur(x_domain, y_domain, N, CB, cell_size, min_dist)
# ---------- end py3_5 ----------
py3_6 = Python3Script(
    x_domain=dam.DataA,
    y_domain=dam.DataB,
    N=dam.DataC,
    CB=dam.DataD,
    C1=dam.DataE,
    C0=dam.DataF,
    cell_size=".2",
    gamma=nicht_lineare_abnahme,
    min_dist=list)  # -> points; inputs N: Int32, CB: Curve, C1: Curve, C0: Curve, cell_size: Double, gamma: Double, min_dist: Double
# ---------- py3_6: Python ----------
from jh_ghp_tools import verlaufsschraffur_kurve_kurve

points = verlaufsschraffur_kurve_kurve(x_domain, y_domain, N, CB, C1, C0, cell_size, gamma, min_dist)
# ---------- end py3_6 ----------
list_2 = ValueList({"1:500": .025, "1:200": 0.01, "1:100": 0.005, "1:50": 0.0025, "1:20": 0.001}, selected="1:50")
isonometrie_2 = Panel(".1")
py3_7 = Python3Script(P=py3_6, L=list_2)  # -> C; inputs P: list of Point3d, L: Double
# ---------- py3_7: Python ----------
from jh_ghp_tools import random_lines_from_points

C = random_lines_from_points(P, L)
# ---------- end py3_7 ----------
group = Group(Objects=py3_7)
