# Grasshopper definition volumen slicen.gh (Grasshopper 1.0.8)
# plug-ins: Human

pipeline = GeometryPipeline(
    GroupByLayer=False,
    GroupByType=False,
    IncludeHidden=False,
    IncludeLocked=True,
    LayerFilter="Varianten*",
    NameFilter="*",
    SublayerFiltering=True,
    TypeFilter=1073741848)
panel = Panel("4")
panel_2 = Panel("2.75")

py3 = Python3Script(reset=Button())  # -> a
# ---------- py3: Python ----------
from compas_ghpython import unload_modules

unload_modules("jh_ghp_tools")

if reset:
    unload_modules("jh_ghp_tools")
# ---------- end py3 ----------

py3_2 = Python3Script(B=pipeline, ID=pipeline, top_on=Toggle(False))  # -> C, A, T; inputs B: list of Brep, ID: list of Guid, h_eg: Double, h_og: Double
# ---------- py3_2: Python ----------
from jh_ghp_tools import volumen_slicen
import ghpythonlib.components as gh


C, A, T = volumen_slicen(B, ID, h_eg, h_og, top_on)
# ---------- end py3_2 ----------
panel_3 = Panel("""soll 5400 m²
+ 360 für Loggias""")
panel_4 = Panel(py3_2.A)
crv = Curve(py3_2.C)
pt = Point()
panel_5 = Panel(py3_2.T)
previewlw = CustomPreviewLineweights(Geometry=crv, Shader=ColourSwatch(SwatchColor=RGB(0, 0, 0)), Absolute=False)
tag = TextTag3D(Location=pt, Text=py3_2.A, Size="2", Colour=ColourSwatch(SwatchColor=RGB(0, 0, 0)), Justification=5)
