# Grasshopper definition vss parkfelder.gh (Grasshopper 1.0.8)

parkfeldbreite = ValueList({"2.50", "2.55", "2.60", "2.65", "2.70", "2.75", "2.80"}, selected="2.70")
# Mögliche Parkfeldbreiten:
# 
# 90	2.50 bis 2.80
# 75	2.50 oder 2.65
# 70	2.50 oder 2.70
# 60	2.50 oder 2.80
# 45	2.50
# 30	2.50
gegenverkehr = BooleanToggle(False)
winkel = ValueList({"90", "75", "70", "60", "45", "30"}, selected="90")

py3 = Python3Script(reset=Button())  # -> a
# ---------- py3: Python ----------
from compas_ghpython import unload_modules

unload_modules("jh_ghp_tools")

if reset:
    unload_modules("jh_ghp_tools")
# ---------- end py3 ----------

list = ValueList({"15", "18"}, selected="15")
py3_2 = Python3Script(Gv=gegenverkehr, W=winkel, Pf=parkfeldbreite, U=Slider(4, range=0..6), V=Slider(10, range=0..20))  # -> Info, Geo; inputs W: Double, Pf: Double, U: Int32, V: Int32
# ---------- py3_2: Python ----------
from jh_ghp_tools import vss_parkierungsnorm

Geo, Info = vss_parkierungsnorm(Gv, W, Pf, U, V)
# ---------- end py3_2 ----------
py3_3 = Python3Script(geschosshoehe=Slider(3.484, range=2..4), gefaelle=list)  # -> rampe, laenge; inputs geschosshoehe: Double, gefaelle: Double
# ---------- py3_3: Python ----------
from jh_ghp_tools import rampe_im_schnitt

rampe, laenge = rampe_im_schnitt(geschosshoehe, gefaelle)
# ---------- end py3_3 ----------
panel = Panel(py3_2.Info)
group = Group(Geometry=py3_2.Geo)
panel_2 = Panel(py3_3.laenge)
