# Grasshopper definition vss rampe im schnitt.gh (Grasshopper 1.0.8)

geschosshöhe = Slider(2.6, range=2..5)
gefälle = ValueList({"15", "18"}, selected="18")

py3 = Python3Script(reset=Button())  # -> a
# ---------- py3: Python ----------
from compas_ghpython import unload_modules


unload_modules("jh_ghp_tools")

if reset:
    unload_modules("jh_ghp_tools")
# ---------- end py3 ----------

py3_2 = Python3Script(Gh=geschosshöhe, Gef=gefälle)  # -> C, L; inputs Gh: Double, Gef: Double
# ---------- py3_2: Python ----------
from jh_ghp_tools import vss_rampe_im_schnitt


C, L = vss_rampe_im_schnitt(Gh, Gef)
# ---------- end py3_2 ----------
länge_rampe = Panel(py3_2.L)
