# Grasshopper definition zweistundenschatten.gh (Grasshopper 1.0.8)

py3 = Python3Script(reset=Button())  # -> a
# ---------- py3: Python ----------
from compas_ghpython import unload_modules

unload_modules("jh_ghp_tools")

if reset:
    unload_modules("jh_ghp_tools")
# ---------- end py3 ----------

brep = Brep(<brep referenced from the Rhino model>)

# ---- group: gemäss Zürich
x_stundenschatten = Panel("2")
py3_2 = Python3Script(B=brep, tag="29", monat="10", start="8", end="17", delta=x_stundenschatten)  # -> regions, match_points_outer, schatten; inputs B: Brep, tag: Int32, monat: Int32, start: Double, end: Double, schritt: Int32, delta: Int32
# ---------- py3_2: Python ----------
from jh_ghp_tools import zweistundenschatten


regions, match_points_outer, schatten = zweistundenschatten(B, tag, monat, start, end, schritt, delta)
# ---------- end py3_2 ----------

# ----
py3_3 = Python3Script(B=brep, t=Slider(9.716, range=0..24))  # -> vec, S; inputs B: Brep
# ---------- py3_3: Python ----------
from jh_ghp_tools import schatten

vec, S = schatten(B, t)
# ---------- end py3_3 ----------
Z = UnitZ(Factor=expr(".01", 1))
boundary = BoundarySurfaces(Edges=py3_3.S)
boundary_2 = BoundarySurfaces(Edges=py3_2.regions)
move = Move(Geometry=py3_2.schatten, Motion=Z)  # -> Geometry, Transform
preview = CustomPreview(Geometry=boundary, Material=ColourSwatch(SwatchColor=RGB(255, 206, 161)))
preview_2 = CustomPreview(Geometry=move.Geometry, Material=ColourSwatch(SwatchColor=RGBA(0, 0, 0, 234)))
preview_3 = CustomPreview(Geometry=boundary_2, Material=ColourSwatch(SwatchColor=RGBA(0, 0, 0, 140)))
hatch = ModelHatch(Boundary=move.Geometry)  # -> Hatch, Boundary, Plane, HatchPattern, BasePoint, Rotation, Scale, ShowBoundary, Background, FillStyle
